# Grasshopper definition RecursionTriangle.gh (Grasshopper 1.0.7)

ghpython_script = GhPythonScript(Depth=Slider(4, range=1..10))  # -> out, Geometry; inputs Depth: Int32
# ---------- ghpython_script: Python ----------
__author__ = "USER"
__version__ = "2024.11.04"

import rhinoscriptsyntax as rs

A = (0,0,0)
B = (50,100,0)
C = (100,0,0)
Triangles = [rs.AddPolyline([A,B,C,A])]
Geometry = Triangles
for i in range(Depth):
    newTriangles = []
    for triangle in Triangles:
        points = rs.PolylineVertices(triangle)
        for i in range(3): # each corner of triangle
            newTriangles +=[rs.ScaleObject(triangle,points[i],(0.5,0.5,0.5),True)]
    Triangles += newTriangles
# ---------- end ghpython_script ----------
curve = Curve(ghpython_script.Geometry)
panel = Panel(ghpython_script.out)
